# Grasshopper definition workout2 holocaust memorial.gh (Grasshopper 1.0.7)

recgrid = Rectangular(
    Plane=PlaneXY(0, 0, 0),
    SizeX=Slider(10.7, range=0..100),
    SizeY=Slider(5.7, range=0..100),
    ExtentX=Slider(41, range=0..100),
    ExtentY=Slider(53, range=0..100))  # -> Cells, Points
pt = Point(recgrid.Points)
crv = Curve(<curve referenced from the Rhino model>)
incurve = PointInCurve(Point=pt, Curve=crv)  # -> Relationship, Point
cull = CullPattern(List=pt, CullPattern=incurve.Relationship)
flatten = FlattenTree(Tree=cull, Path="{0}")
crv_cp = CurveClosestPoint(Point=flatten, Curve=crv)  # -> Point, Parameter, Distance
lng = ListLength(List=flatten)
division = Division(A="1", B=crv_cp.Distance)
dom = ConstructDomain(DomainStart=0, DomainEnd=Slider(0.5, range=0..100))
random = Random(Range=dom, Number=lng, Seed=Slider(2, range=0..10))
larger = LargerThan(FirstNumber=random, SecondNumber=division)  # -> LargerThan, OrEqualTo
cull_2 = CullPattern(List=flatten, CullPattern=larger.LargerThan)
Z = UnitZ(Factor="-1")
srf = Surface(<surface referenced from the Rhino model>)
project = ProjectPoint(Point=cull_2, Direction=Z, Geometry=srf)  # -> Point, Index
xy = XYPlane(Origin=project.Point)

pln = Plane(xy)
number_slider = Slider(3, range=0..10)
deplane = DeconstructPlane(Plane=pln)  # -> Origin, XAxis, YAxis, ZAxis
lng_2 = ListLength(List=pln)
neg = Negative(Value=number_slider)
dom_2 = ConstructDomain(DomainStart=neg, DomainEnd=number_slider)
random_2 = Random(Range=dom_2, Number=lng_2, Seed=Slider(0, range=0..10))
random_3 = Random(Range="0 to 360", Number=lng_2, Seed=Slider(0, range=0..10))
rot3d = Rotate3D(Geometry=deplane.XAxis, Angle=degrees(random_3), Center=Point(0, 0, 0), Axis=deplane.ZAxis)  # -> Geometry, Transform
rot3d_2 = Rotate3D(Geometry=pln, Angle=degrees(random_2), Center=deplane.Origin, Axis=rot3d.Geometry)  # -> Geometry, Transform
pln_2 = Plane(rot3d_2.Geometry)

number_slider_2 = Slider(1.8, range=0..10)
number_slider_3 = Slider(3.57, range=0..10)
deplane_2 = DeconstructPlane(Plane=pln_2)  # -> Origin, XAxis, YAxis, ZAxis
neg_2 = Negative(Value=number_slider_3)
neg_3 = Negative(Value=number_slider_2)
srf_2 = Surface(<surface referenced from the Rhino model>)
project_2 = ProjectPoint(Point=deplane_2.Origin, Direction=deplane_2.ZAxis, Geometry=srf_2)  # -> Point, Index
dom_3 = ConstructDomain(DomainStart=neg_2, DomainEnd=number_slider_3)
dom_4 = ConstructDomain(DomainStart=neg_3, DomainEnd=number_slider_2)
dist = Distance(PointA=deplane_2.Origin, PointB=project_2.Point)
box = DomainBox(Base=pln_2, X=dom_3, Y=dom_4, Z=dist)
preview = CustomPreview(Material={diffuse=RGB(221, 160, 221), emission=RGB(66, 48, 66), shine=0.5, specular=RGB(255, 255, 255), transparency=0})
